# Grasshopper definition Firefly01.gh (Grasshopper 0.9.76)
# plug-ins: Firefly.Core

ports_available = COMPortsAvailable()
bool = Boolean(True)
open_port = OpenClosePort(OpenClosePort=bool, PortNumber=ports_available, BaudRate=115200)
bool_2 = Boolean(True)
uno_read = UnoRead(StartReadingValues=bool_2, PortNumber=ports_available)  # -> AnalogPin0, AnalogPin1, AnalogPin2, AnalogPin3, AnalogPin4, AnalogPin5, DigitalPin2, DigitalPin4, DigitalPin7, StatusMessage
txt = Text(uno_read.AnalogPin5)
txt_2 = Text(uno_read.AnalogPin4)
txt_3 = Text(uno_read.DigitalPin4)
txt_4 = Text(uno_read.DigitalPin7)
txt_5 = Text(uno_read.DigitalPin2)
txt_6 = Text(uno_read.AnalogPin2)
txt_7 = Text(uno_read.AnalogPin1)
txt_8 = Text(uno_read.AnalogPin3)
txt_9 = Text(uno_read.AnalogPin0)
